# Grasshopper definition assignment-01.gh (Grasshopper 1.0.8)

base_point_x = Slider(7.65, range=0..20)
base_point_y = Slider(9.01, range=0..20)
base_point_z = Slider(12.92, range=0..20)
base_point_x_2 = Slider(10, range=0..20)
base_point_y_2 = Slider(10, range=0..20)
base_point_z_2 = Slider(78.124, range=0..100)
base_point_y_3 = Slider(10, range=0..50)
# Assignment-01: Bauhaus
base_point_x_3 = Slider(0, range=0..1)
base_point_y_4 = Slider(0, range=0..1)
base_point_z_3 = Slider(0, range=0..1)
base_point_x_4 = Slider(10, range=0..50)
base_point_z_4 = Slider(60, range=0..100)
base_point_x_5 = Slider(0, range=0..100)
base_point_y_5 = Slider(0, range=0..100)
base_point_z_5 = Slider(0, range=0..1)
base_point_x_6 = Slider(2.5, range=0..50)
base_point_y_6 = Slider(2.5, range=0..50)
base_point_y_7 = Slider(10, range=0..20)
base_point_z_6 = Slider(40, range=0..100)
base_point_x_7 = Slider(10, range=0..20)
base_point_z_7 = Slider(34.268, range=0..50)

# ---- group: Auto-reloads cdf module on VScode changes
# Setting path for Src AutoReloader: 1. Right click on Path
# 2. Choose "Select a directory"
# 3. Locate the ..\cdf1_teaching\src folder in your computer
path = FilePath("C:\D\TUM\s3\Computational Design and Fabrication I\workspace\cdf1_teaching\src\")
autoreloader = Python3Script(src_path=path)  # -> out; inputs src_path: String
# ---------- autoreloader: Python ----------
#! python3
import sys, os, time
import scriptcontext as sc
import Rhino, System
from System.IO import FileSystemWatcher, NotifyFilters

VERSION = 1  
pkg = "cdf"

if not src_path:
    raise Exception("Connect a folder to src_path.")
path = os.path.normpath(src_path)
watch_dir = os.path.join(path, pkg)
if not os.path.isdir(watch_dir):
    raise Exception("No '{}' folder found in:\n{}".format(pkg, path))

def unload():
    for name in list(sys.modules):
        if name == pkg or name.startswith(pkg + "."):
            del sys.modules[name]

# Put this folder first in Python's search list
if path in sys.path:
    sys.path.remove(path)
sys.path.insert(0, path)

key = "cdf_watcher_" + str(ghenv.Component.InstanceGuid)
time_key = key + "_time"
version_key = key + "_version"

def stamp():
    sc.sticky[time_key] = time.strftime("%Y-%m-%d %H:%M:%S")

# Replace the old watcher if the folder changed or the script was updated
old = sc.sticky.get(key)
if old is not None and (os.path.normpath(old.Path) != watch_dir
                        or sc.sticky.get(version_key) != VERSION):
    old.Dispose()
    del sc.sticky[key]
    unload()

if key not in sc.sticky:
    comp = ghenv.Component
    last = [0.0]

    def reload_and_rerun():
        unload()
        stamp()
        doc = comp.OnPingDocument()
        if doc is None:            # reloader was deleted or the file closed
            return
        for obj in doc.Objects:
            if "Python" in obj.GetType().Name:
                obj.ExpireSolution(False)   # mark as out of date
        doc.NewSolution(False)              # recompute once

    def on_change(sender, e):
        if not e.FullPath.endswith(".py") or "__pycache__" in e.FullPath:
            return
        if time.time() - last[0] < 0.5:     # ignore the second event of a double save
            return
        last[0] = time.time()
        Rhino.RhinoApp.InvokeOnUiThread(System.Action(reload_and_rerun))

    w = FileSystemWatcher(watch_dir, "*.py")
    w.IncludeSubdirectories = True
    w.NotifyFilter = NotifyFilters.LastWrite
    w.Changed += on_change
    w.EnableRaisingEvents = True
    sc.sticky[key] = w
    sc.sticky[version_key] = VERSION
    stamp()                                  # time the watcher started

msg = "Last reloaded: {}\nWatching: {}".format(sc.sticky.get(time_key, "unknown"), watch_dir)
print(msg)
out = msg
# ---------- end autoreloader ----------
panel = Panel(autoreloader)

# ----
radius_input = Slider(20, range=0.1..20)
radius_input_2 = Slider(5.815, range=0.1..20)
height_input = Slider(20, range=0.1..20)
height_input_2 = Slider(20, range=0.1..20)
radius_input_3 = Slider(7.5, range=0.1..20)
height_input_3 = Slider(40, range=0.1..400)
radius_input_4 = Slider(5.488, range=0.1..20)
height_input_4 = Slider(20, range=0.1..400)
radius_input_5 = Slider(15.139, range=0.1..20)
width_input = Slider(200, range=0.1..400)
height_input_5 = Slider(1.76, range=0.1..20)
width_input_2 = Slider(20, range=0.1..400)
width_input_3 = Slider(15, range=0.1..400)
length_input = Slider(200, range=0.1..400)
length_input_2 = Slider(20, range=0.1..400)
length_input_3 = Slider(15, range=0.1..400)
pt = ConstructPoint(XCoordinate=base_point_x, YCoordinate=base_point_y, ZCoordinate=base_point_z)
pt_2 = ConstructPoint(XCoordinate=base_point_x_2, YCoordinate=base_point_y_2, ZCoordinate=base_point_z_2)
pt_3 = ConstructPoint(XCoordinate=base_point_x_4, YCoordinate=base_point_y_3, ZCoordinate=base_point_z_4)
pt_4 = ConstructPoint(XCoordinate=base_point_x_7, YCoordinate=base_point_y_7, ZCoordinate=base_point_z_7)
pt_5 = ConstructPoint(XCoordinate=base_point_x_3, YCoordinate=base_point_y_4, ZCoordinate=base_point_z_3)
pt_6 = ConstructPoint(XCoordinate=base_point_x_5, YCoordinate=base_point_y_5, ZCoordinate=base_point_z_5)
pt_7 = ConstructPoint(XCoordinate=base_point_x_6, YCoordinate=base_point_y_6, ZCoordinate=base_point_z_6)
sphere = Python3Script(center_point=pt_3, radius=radius_input_3)  # -> out, my_sphere; inputs center_point: Point3d
# ---------- sphere: Python ----------
from cdf import create_sphere
my_sphere = create_sphere(center_point, radius)
# ---------- end sphere ----------
torus = Python3Script(center_point=pt_4, major_radius=radius_input_5, minor_radius=radius_input_4)  # -> out, my_torus; inputs center_point: Point3d
# ---------- torus: Python ----------
from cdf import create_torus
my_torus = create_torus(center_point, major_radius, minor_radius)
# ---------- end torus ----------
cylinder = Python3Script(base_point=pt_2, radius=radius_input_2, height=height_input_2)  # -> out, my_cylinder; inputs base_point: Point3d
# ---------- cylinder: Python ----------
from cdf import create_cylinder
my_cylinder = create_cylinder(base_point, height, radius)
# ---------- end cylinder ----------
cone = Python3Script(base_point=pt, radius=radius_input, height=height_input)  # -> out, my_cone; inputs base_point: Point3d
# ---------- cone: Python ----------
from cdf import create_cone
my_cone = create_cone(base_point, height, radius)
# ---------- end cone ----------
cube = Python3Script(base_point=pt_5, length=length_input, width=width_input, height=height_input_5)  # -> out, my_cube; inputs base_point: Point3d
# ---------- cube: Python ----------
from cdf import create_cube
my_cube = create_cube(base_point, length, width, height)

print("length:", length)
print("width:", width)
print("height:", height)
# ---------- end cube ----------
cube_2 = Python3Script(base_point=pt_6, length=length_input_2, width=width_input_2, height=height_input_3)  # -> out, my_cube; inputs base_point: Point3d; same code as cube
cube_3 = Python3Script(base_point=pt_7, length=length_input_3, width=width_input_3, height=height_input_4)  # -> out, my_cube; inputs base_point: Point3d; same code as cube
preview = CustomPreview(Geometry=cone.my_cone, Material=ColourSwatch(SwatchColor=RGB(41, 180, 227)))
preview_2 = CustomPreview(Geometry=cylinder.my_cylinder, Material=ColourSwatch(SwatchColor=RGB(103, 194, 224)))
preview_3 = CustomPreview(Geometry=sphere.my_sphere, Material=ColourSwatch(SwatchColor=RGB(25, 88, 156)))
preview_4 = CustomPreview(Geometry=torus.my_torus, Material=ColourSwatch(SwatchColor=RGB(39, 133, 232)))
preview_5 = CustomPreview(Geometry=cube.my_cube, Material=ColourSwatch(SwatchColor=RGB(15, 64, 92)))
preview_6 = CustomPreview(Geometry=cube_2.my_cube, Material=ColourSwatch(SwatchColor=RGB(140, 64, 31)))
preview_7 = CustomPreview(Geometry=cube_3.my_cube, Material=ColourSwatch(SwatchColor=RGB(140, 64, 31)))
rotate_brep = Python3Script(angle_degrees=Slider(184.929, range=0..360))  # -> out, rotated_brep; inputs brep: Brep, angle_degrees: Double, axis_point: Point3d, axis_direction: Vector3d
# ---------- rotate_brep: Python ----------
from cdf import rotate_brep

rotated_brep = rotate_brep(brep, angle_degrees, axis_point, axis_direction)
# ---------- end rotate_brep ----------
boolean_difference = Python3Script(brep_a=cube_2.my_cube, brep_b=torus.my_torus)  # -> out, new_brep; inputs brep_a: Brep, brep_b: Brep
# ---------- boolean_difference: Python ----------
from cdf import boolean_difference
new_brep = boolean_difference(brep_a, brep_b)
# ---------- end boolean_difference ----------
boolean_union = Python3Script(brep_a=cube_3.my_cube, brep_b=boolean_difference.new_brep)  # -> out, new_brep; inputs brep_a: Brep, brep_b: Brep
# ---------- boolean_union: Python ----------
from cdf import boolean_union
new_brep = boolean_union(brep_a, brep_b)
# ---------- end boolean_union ----------
preview_8 = CustomPreview(Geometry=boolean_difference.new_brep, Material=ColourSwatch(SwatchColor=RGB(143, 135, 255)))
preview_9 = CustomPreview(Geometry=boolean_union.new_brep, Material=ColourSwatch(SwatchColor=RGB(143, 135, 255)))
preview_10 = CustomPreview(Geometry=rotate_brep.rotated_brep, Material=ColourSwatch(SwatchColor=RGB(143, 135, 255)))
